# Grasshopper definition GH_python_remote.ghx (Grasshopper 1.0.7)

# Turn me on!   -->
python = PythonScript()  # -> rhino_doc_dir
# ---------- python: Python ----------
import scriptcontext as sc
from os import path

rhino_doc_dir = path.abspath(path.dirname(sc.doc.Path))
# ---------- end python ----------
list = ValueList({"CRITICAL", "ERROR", "WARNING", "INFO", "DEBUG", "NOTSET"}, selected="DEBUG")

# ---- group: Import remote python modules
panel = Panel(python)
panel_2 = Panel("""numpy
scipy
numpy.linalg""")
# GH to python remote example.
# ⓒ Pierre Cuvilliers, 2017-2022
# Released under the MIT license
# github.com/pilcru/ghpythonremote
# Runs and connects to an external python engine, and
# assigns imported modules to scriptcontext.sticky variables.
# 
# Arguments:
#       code (str): Path to the GH_to_python.py code file.
#       location (str): Path to a python executable, or to a folder
#             containing `python.exe`, or the name of a conda-created
#             virtual environment prefixed by `conda://` (`conda://env_name`).
#             If empty, finds python from your windows %PATH%.
#       run (boolean): Creates the connection, and imports new
#             modules, when turned to True. Kills the connection,
#             and deletes the references to the imports, when turned
#             to False.
#       modules (str list): List of module names to import in the
#             remote python. They will be added to the
#             scriptcontext.sticky dictionary, allowing them to be
#             reused from other python components in the same
#             Grasshopper document. Submodules (for example
#             `numpy.linalg`) have to be added explicitly to this list
#             to be available later, and importing the parent package is
#             also required even if only the submodule is used.
#       log_level (str from ['NOTSET', 'DEBUG', 'INFO', 'WARNING', 'ERROR', 'CRITICAL']):
#             Logging level to use for the local IronPython and the
#             remote python instance.
#       working_dir (str): Working directory for the remote python
#             instance.
# 
# Returns:
#       out (str): Console output with DEBUG information.
#       linked_modules (str list): list of imported module names.
#       rpy (rpyc connection object): The object representing the remote Python interpreter.
panel_3 = Panel("conda://rhinoremote")
ghpythonremote = GHPythonRemote(location=panel_3, run=Toggle(False), modules=panel_2, log_level=list, working_dir=panel)  # -> out, linked_modules, rpy; inputs run: Boolean, modules: list
# ---------- ghpythonremote: Python ----------
import inspect
import logging
from os import path
import sys
from time import sleep

import scriptcontext

import ghpythonremote
from ghpythonremote.connectors import GrasshopperToPythonRemote
from Grasshopper.Kernel.GH_RuntimeMessageLevel import Error, Warning

local_log_level = getattr(logging, log_level, logging.WARNING)
logger = logging.getLogger("ghpythonremote")
logger.setLevel(local_log_level)
ch = logging.StreamHandler()
ch.setLevel(local_log_level)
formatter = logging.Formatter("%(levelname)s: %(name)s:\n%(message)s")
ch.setFormatter(formatter)
logger.handlers = []
logger.addHandler(ch)
logger = logging.getLogger("ghpythonremote.GH_to_python")

ROOT = path.abspath(path.dirname(inspect.getfile(ghpythonremote)))
rpyc_server_py = path.join(ROOT, "pythonservice.py")

cluster_comp = ghenv.Component.OnPingDocument().Owner

# Set connection to CLOSED if this is the first run
# and initialize set of linked modules
try:
    remote_python_status
except NameError:
    remote_python_status = "CLOSED"
    lkd_modules = set()

# Wait for connection to connect or terminate
timer = 0
while remote_python_status == "CONNECTING" or remote_python_status == "CLOSING":
    sleep(1)
    timer += 1
    if timer == 10:
        try:
            gh2py_manager.__exit__(*sys.exc_info())
        except Exception:
            pass
        remote_python_status = "CLOSED"
        lkd_modules = set()
        message = (
            "Connection left in an inconsistent state and not returning. Reset "
            "everything."
        )
        if cluster_comp is not None:
            cluster_comp.AddRuntimeMessage(Warning, message)
        raise RuntimeError(message)

if run:
    if not remote_python_status == "OPEN":
        remote_python_status = "CONNECTING"
        gh2py_manager = GrasshopperToPythonRemote(
            rpyc_server_py,
            location=location,
            timeout=10,
            port=None,
            log_level=log_level,
            working_dir=working_dir,
        )
        gh2py = gh2py_manager.__enter__()
        remote_python_status = "OPEN"

    # Stuff that we can reach
    rpymod = gh2py.py_remote_modules  # A getter function for a named python module
    rpy = gh2py.connection  # Represents the remote instance root object
    scriptcontext.sticky["rpy"] = rpy
    # Add modules
    for mod in modules:
        try:
            scriptcontext.sticky[mod] = rpymod(mod)
            lkd_modules.add(mod)
        except ImportError:
            gh2py_manager.__exit__(*sys.exc_info())
            if cluster_comp is not None:
                cluster_comp.AddRuntimeMessage(
                    Error,
                    'Could not import module "{}" in remote Python.'.format(mod)
                )
            raise
        except EOFError:
            if cluster_comp is not None:
                cluster_comp.AddRuntimeMessage(
                    Error,
                    'Remote Python has been closed unexpectedly'
                )
            raise

elif not remote_python_status == "CLOSED":
    remote_python_status = "CLOSING"
    # Remove linked modules
    for mod in lkd_modules:
        del scriptcontext.sticky[mod]
    del scriptcontext.sticky["rpy"]
    gh2py_manager.__exit__(*sys.exc_info())
    lkd_modules = set()
    remote_python_status = "CLOSED"

# Change variable name because ghpython resets outputs to None before each run
linked_modules = lkd_modules

logger.info("GH to python connection is {}".format(remote_python_status))
# ---------- end ghpythonremote ----------
panel_4 = Panel(ghpythonremote.out)

# ----
python_2 = PythonScript(module_names=ghpythonremote.linked_modules)  # -> import_statements; inputs module_names: list
# ---------- python_2: Python ----------
import_statements = ["import scriptcontext as sc"]
for module_name in module_names:
    import_statements.append("{0} = sc.sticky['{0}']".format(module_name))

if len(module_names) == 0:
    import_statements = []
# ---------- end python_2 ----------
panel_5 = Panel(python_2)

# ---- group: Use numpy, click to open and run
python_3 = PythonScript()  # -> out, a
# ---------- python_3: Python ----------
import scriptcontext
import ghpythonremote
np = scriptcontext.sticky['numpy']
rpy = scriptcontext.sticky['rpy']
# Do some numpy stuff
a = np.arange(15).reshape(3, 5)
print(a)
print(np.linalg.eig(np.arange(9).reshape(3, 3)))

# Fast way of sending data for numpy array creation
remote_range = ghpythonremote.deliver(rpy, range(1000))
array = np.array(remote_range)
# This is much slower
#b = np.array(range(1000))

# Get the array back as a local IronPython list
list = ghpythonremote.obtain(array.tolist())

# Get an error
#np.arange(9).reshape(4,3)
# ---------- end python_3 ----------
panel_6 = Panel(python_3.out)
